# Grasshopper definition UmiAsCSTester.gh (Grasshopper 1.0.7)
# plug-ins: ClimateStudioGH, jSwan

epw = Panel("D:\Users\zoelh\Dropbox (MIT)\Thesis Work\Building Energy References\ReferenceBuildings\USA_FL-MIAMI.722020_TMY2-12839.epw")

wwr = Slider(0.4, range=0.1..0.9)
floor_to_foor_height = Panel("3")
perim_offset = Panel("3")

output = Panel("D:\Users\zoelh\Dropbox (MIT)\Thesis Work\Florianopolis\CS Sensitivity\")

# ----
# RUN
button = Button()

getsublayerobjects = GhPythonScript(Parent="umi::Buildings")  # -> simplify(Subs), Names
# ---------- getsublayerobjects: Python ----------
__author__ = "zoelh"
__version__ = "2023.11.15"

import rhinoscriptsyntax as rs
import scriptcontext as sc
import Rhino
#import GhPython as gp
import ghpythonlib.treehelpers as th

sc.doc = Rhino.RhinoDoc.ActiveDoc
layernames = []

if Parent:
    for layername in rs.LayerNames():
        if layername.startswith(Parent+"::"):
            layernames.append(layername)
print(layernames)
layerTree = [list() for _ in layernames]
for i, layername in enumerate(layernames):
    objs = rs.ObjectsByLayer(layername)
    if objs:
        layerTree[i].append(objs)
layerTree = th.list_to_tree(layerTree)
Subs = layerTree
Names = [x.split("::")[-1] for x in layernames]
# ---------- end getsublayerobjects ----------
zone_template = GetCSZoneTemplate(SearchZoneTemplate="*MediumOffice*1A", Selection="90.1-2019 MidriseApartment - Apartment_topfloor_WE CZ 2")
panel = Panel(getsublayerobjects.Names)
dejson = DeserializeJson(JSON=zone_template, OutputsLocked=False)  # -> Constructions, Loads, Conditioning, HotWater, NaturalVentilation, Foundation, Infiltration, CostEmissions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
data = Data(flatten(getsublayerobjects.Subs))
number_slider = Slider(0, range=0..92)
bang = ExplodeTree(Data=getsublayerobjects.Subs)  # -> Branch0, Branch1, Branch2, Branch3, Branch4, Branch5, Branch6, Branch7, Branch8, Branch9
panel_2 = Panel(dejson.Name)
panel_3 = Panel(dejson.Conditioning)
by_layer = Data(bang.Branch2)
by_building = Data(simplify(graft(data)))
item = ListItem(List=data, Index=number_slider, Wrap=True)
debrep = DeconstructBrep(Brep=item)  # -> Faces, Edges, Vertices
single_building = Data(simplify(graft(item)))
climate_zone_number_only = Panel("2A")
# Reference Building CS Lib: C:\ProgramData\Solemma\Common\Library\DOE Reference Buildings.csl
expression = Expression(x=panel, y=climate_zone_number_only, Expression="Format(\"*{0}*{1}*\", x, y)")
data_2 = Data(debrep.Edges)
cluster = Cluster(brep=by_building, B_2=floor_to_foor_height, offset=perim_offset, B=wwr)  # -> perim, core, ground, roof, windows
python = GhPythonScript(x=single_building)  # -> guid
# ---------- python: Python ----------
__author__ = "zoelh"
__version__ = "2023.11.17"

import rhinoscriptsyntax as rs

#sc.doc = rc.RhnoDoc.ActiveDoc
#
#allObjects = rs.AllObjects()

guid = str(x)
# ---------- end python ----------
zone_template_2 = GetCSZoneTemplate(SearchZoneTemplate=expression, Selection="90.1-2019 MidriseApartment - Apartment_topfloor_WE CZ 2")
trim = TrimTree(Tree=cluster.core, Depth=1)
trim_2 = TrimTree(Tree=cluster.perim, Depth=1)
panel_4 = Panel(python)
dejson_2 = DeserializeJson(JSON=zone_template_2, OutputsLocked=False)  # -> Constructions, Loads, Conditioning, HotWater, NaturalVentilation, Foundation, Infiltration, CostEmissions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
lng = ListLength(List=trim)  # -> flatten(Length)
lng_2 = ListLength(List=trim_2)  # -> flatten(Length)
wset = CSWindowSettings(
    Name="Window Non-res Fixed",
    Input_0_Hidden=False,
    Input_0_Name="Name",
    Input_10_Hidden=True,
    Input_10_Name="ShadingThickness",
    Input_11_Hidden=True,
    Input_11_Name="ShadeGlassDistance",
    Input_12_Hidden=True,
    Input_12_Name="TopBottomEdgeOpeningMultiplier",
    Input_13_Hidden=True,
    Input_13_Name="Analysis Mesh Resolution",
    Input_14_Hidden=True,
    Input_14_Name="ZoneMixingIsOn",
    Input_15_Hidden=True,
    Input_15_Name="ZoneMixingDeltaTemperature",
    Input_16_Hidden=True,
    Input_16_Name="ZoneMixingFlowRate",
    Input_17_Hidden=True,
    Input_17_Name="Glazing Construction",
    Input_18_Hidden=True,
    Input_18_Name="OperableArea",
    Input_19_Hidden=True,
    Input_19_Name="ZoneMixingAvailibilitySchedule",
    Input_1_Hidden=False,
    Input_1_Name="WindowSettings",
    Input_20_Hidden=True,
    Input_20_Name="HasFrame",
    Input_21_Hidden=True,
    Input_21_Name="FrameWidth",
    Input_22_Hidden=True,
    Input_22_Name="FrameProjection"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)
python_2 = GhPythonScript(Zones=lng, Type="Core")  # -> Names; inputs Zones: list of Int32
# ---------- python_2: Python ----------
__author__ = "zoelh"
__version__ = "2023.11.17"

import rhinoscriptsyntax as rs
import ghpythonlib.treehelpers as th

nms = []

for i, item in enumerate(Zones):
    print(item)
    for j in range(item):
        n = "bldg_" + str(i) +"_"+Type+"_" + "_zone_" + str(j)
        print(n)
        nms.append(n)
        
Names = nms
# ---------- end python_2 ----------
python_3 = GhPythonScript(Zones=lng_2, Type="Perim")  # -> Names; inputs Zones: list of Int32; same code as python_2
panel_5 = Panel(dejson_2.Name)
simple_window = ConstructCSSimpleWindow(Name="DOE2004", Shgf="0.65", Uval="4.8", Tvis="0.5")
bc = BoundaryCondition(Brep=flatten(cluster.ground), FFactor=0.2, CFactor=0.2, type="GROUND")

# ----
# Model Setup
zone = ThermalZone(
    Brep=flatten(cluster.perim),
    Name=python_3,
    Settings=zone_template,
    UsedLibraryObjects="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")  # -> Zones, Settings
zone_2 = ThermalZone(
    Brep=flatten(cluster.core),
    Name=python_2,
    Settings=zone_template,
    UsedLibraryObjects="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")  # -> Zones, Settings
window = Window(Surface=flatten(cluster.windows), Settings=wset, UsedLibraryObjects="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")  # -> Window, Settings
networker = Networker(
    Zones=flatten([zone_2.Zones, zone.Zones]),
    Windows=window.Window,
    Boundaries=bc,
    preview_displayAdia=True,
    preview_displayExtFloor=True,
    preview_displayFacades=True,
    preview_displayGround=True,
    preview_displayParts=True,
    preview_displayRoofs=True,
    preview_displayShade=True,
    preview_displaySlabs=True,
    preview_displayWins=True)
run_e = RunCSEnergyModel(
    Model=networker,
    Name="ClimateStudio_florianopolis",
    Directory=output,
    Location=epw,
    Run=button,
    settings="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")  # -> Model, Settings, Result

shadingon = BooleanToggle(False)
hasframe = BooleanToggle(False)
shading_mask = CSShadingMask(Pt=Point(0, 0, 0), Dir=Vector(0, 1, 0), Radius=30, HAng=5, VAng=5, Full=True, Mode=0)
expression_2 = Expression(x=number_slider, Expression="Format(\"ClimateStudio_building_{0}\", int(x))")
wset_2 = CSWindowSettings(
    Name="MyWindowSettings",
    Type="External",
    ShadingSystemIsOn=shadingon,
    GlazingConstruction=simple_window,
    OperableArea="0",
    HasFrame=hasframe,
    AFNWindowAvailability="AllOff",
    Input_0_Hidden=False,
    Input_0_Name="Name",
    Input_10_Hidden=True,
    Input_10_Name="ShadingThickness",
    Input_11_Hidden=True,
    Input_11_Name="ShadeGlassDistance",
    Input_12_Hidden=True,
    Input_12_Name="TopBottomEdgeOpeningMultiplier",
    Input_13_Hidden=True,
    Input_13_Name="Analysis Mesh Resolution",
    Input_14_Hidden=True,
    Input_14_Name="ZoneMixingIsOn",
    Input_15_Hidden=True,
    Input_15_Name="ZoneMixingDeltaTemperature",
    Input_16_Hidden=True,
    Input_16_Name="ZoneMixingFlowRate",
    Input_17_Hidden=False,
    Input_17_Name="Glazing Construction",
    Input_18_Hidden=False,
    Input_18_Name="OperableArea",
    Input_19_Hidden=True,
    Input_19_Name="ZoneMixingAvailibilitySchedule",
    Input_1_Hidden=False,
    Input_1_Name="WindowSettings",
    Input_20_Hidden=False,
    Input_20_Name="HasFrame",
    Input_21_Hidden=True,
    Input_21_Name="FrameWidth",
    Input_22_Hidden=True,
    Input_22_Name="FrameProjection"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)
zset = CSZoneSettings(
    Name="MyZoneSettings",
    Input_0_Hidden=False,
    Input_0_Name="Name",
    Input_100_Hidden=True,
    Input_100_Name="Interior Vertical Insulation Depth",
    Input_101_Hidden=True,
    Input_101_Name="Exterior Horizontal Insulation Depth",
    Input_102_Hidden=True,
    Input_102_Name="Exterior Horizontal Insulation Width",
    Input_103_Hidden=True,
    Input_103_Name="Footing Thickness",
    Input_104_Hidden=True,
    Input_104_Name="Footing Depth",
    Input_105_Hidden=True,
    Input_105_Name="ElectricityCO2",
    Input_106_Hidden=True,
    Input_106_Name="ElectricityCost",
    Input_107_Hidden=True,
    Input_107_Name="HotWaterCO2",
    Input_108_Hidden=True,
    Input_108_Name="HotWaterCost",
    Input_109_Hidden=True,
    Input_109_Name="CoolingCO2",
    Input_10_Hidden=True,
    Input_10_Name="Ground Wall Construction",
    Input_110_Hidden=True,
    Input_110_Name="HeatingCO2",
    Input_111_Hidden=True,
    Input_111_Name="CoolingCost",
    Input_112_Hidden=True,
    Input_112_Name="HeatingCost"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)
library = CSLibrary()
toggle = BooleanToggle(False)
energy_results = LoadCSEnergyResult(ThermalModel=run_e.Model, Mode=0, Resolution=0, Toggle=Toggle(True))  # -> TotalEUI, Baseline, TotalCO2, TotalCost, FloorArea, Data, Labels, Months, Colors, CSR
panel_6 = Panel(energy_results.Data)
expression_3 = Expression(x=python, Expression="Format(\"results-out-{0}.json\", x, y)")
energy_results_2 = LoadCSRResultFile(ThermalModel=run_e.Model, Mode=2, Toggle=Toggle(True))  # -> TotalEUI, Baseline, TotalCO2, TotalCost, FloorArea, Data, Labels, Months, Colors, CSR
energy_results_3 = LoadCSRResultFile(ThermalModel=run_e.Model, Mode=0, Toggle=Toggle(True))  # -> TotalEUI, Baseline, TotalCO2, TotalCost, FloorArea, Data, Labels, Months, Colors, CSR
branch = TreeBranch(Tree=energy_results.Data, Path="{5}", MaintainPaths=True)
branch_2 = TreeBranch(Tree=energy_results.Data, Path="{4}", MaintainPaths=True)
plotter = CSPlotter(
    Type=0,
    Width=550,
    Height=450,
    X_labels=energy_results.Months,
    X_rot=0,
    Y_data=energy_results.Data,
    Colors=energy_results.Colors,
    Names=energy_results.Labels,
    Show_xgrid=False,
    Show_ygrid=True,
    Legend=0,
    PreviewDimension=1,
    InfinateZoomDisplay=True,
    UnitSystem=4)
xyplot = XYPlot(
    Type=2,
    Width=550,
    Height=450,
    Title="Loads",
    Y_title="[kWh]",
    X_labels=energy_results_2.Months,
    X_rot=0,
    Y_data=energy_results_2.Data,
    Colors=energy_results_2.Colors,
    Names=energy_results_2.Labels,
    Show_xgrid=False,
    Show_ygrid=True,
    Legend=0)
xyplot_2 = XYPlot(
    Type=2,
    Width=550,
    Height=450,
    Title="EUI",
    Y_title="[kWh/m2/yr]",
    X_labels=energy_results_3.Months,
    X_rot=0,
    Y_data=energy_results_3.Data,
    Colors=energy_results_3.Colors,
    Names=energy_results_3.Labels,
    Show_xgrid=False,
    Show_ygrid=True,
    Legend=0)
panel_7 = Panel(branch)
panel_8 = Panel(branch_2)
panel_9 = Panel(expression_3)
python_4 = GhPythonScript(heating=simplify(panel_8), cooling=simplify(panel_7), outpath=output, name=expression_3)  # -> out, a; inputs heating: tree, cooling: tree
# ---------- python_4: Python ----------
__author__ = "szvsw"
__version__ = "2023.11.15"

import rhinoscriptsyntax as rs
import ghpythonlib.treehelpers as th

heating = heating.Branch(0)
cooling = cooling.Branch(0)
output_data = {
    "heating": [float(val) for val in heating],
    "cooling": [float(val) for val in cooling],
}

import json
if save:
    with open(str(outpath)+name,"w") as f:
        json.dump(output_data,f,indent=4)
# ---------- end python_4 ----------
eval = Evaluate(F="Round(x,1)", x=energy_results_3.TotalEUI)
eval_2 = Evaluate(F="Round(x,1)", x=energy_results_3.Baseline)
eval_3 = Evaluate(F="Round(x,1)", x=energy_results_3.TotalCost)
eval_4 = Evaluate(F="Round(x,1)", x=energy_results_3.TotalCO2)
kg_co2_m2_a = Panel(eval_4)
aia_site_eui_baseline_kwh_pe_m2_a = Panel(eval_2)
m2_a = Panel(eval_3)
site_eui_kwh_m2_a = Panel(eval)
load_zone_results = LoadCSZoneResults(ThermalModel=run_e.Model, Toggle=Toggle(True), byzone="True", settings="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")  # -> ResultsPerZone, Labels, Name, Zone

# ==== cluster Cluster
brep = ClusterInput()
brep_2 = Brep(brep)
B = ClusterInput()
debrep = DeconstructBrep(Brep=brep_2)  # -> Faces, Edges, Vertices
pdecon = Deconstruct(Point=debrep.Vertices)  # -> XComponent, YComponent, ZComponent
debox = DeconstructBox(Box=brep_2)  # -> Plane, X, Y, Z
data = Data(debrep.Edges)
B_2 = ClusterInput()
equals = Equality(FirstNumber=pdecon.ZComponent, SecondNumber=0)  # -> Equality, Inequality
dedomain = DeconstructDomain(Domain=debox.Z)  # -> Start, End
dispatch = Dispatch(List=debrep.Vertices, DispatchPattern=equals.Equality)  # -> ListA, ListB
division = Division(A=dedomain.End, B=B_2)
round = Round(Number=division)  # -> Nearest, Floor, Ceiling
expression = Expression(x=round.Floor, Expression="If(x<1, 1, x)")
shift = ShiftList(List=dispatch.ListA, Shift=-1, Wrap=True)
item = ListItem(List=shift, Index=0, Wrap=True)
division_2 = Division(A=dedomain.End, B=expression)
heights = Data(division_2)
Z = UnitZ(Factor=heights)
multiplication = Multiplication(A=Z)
ins = InsertItems(List=dispatch.ListA, Item=item, Indices=0, Wrap=True)
python = GhPythonScript(h=division_2, c=expression)  # -> l
# ---------- python: Python ----------
__author__ = "zoelh"
__version__ = "2023.11.16"

import ghpythonlib.treehelpers as th
import rhinoscriptsyntax as rs

l = []
for i in range(c):
    l.append(round(i*h, 6))
#l = th.list_to_tree(l)
# ---------- end python ----------
multiplication_2 = Multiplication(A=multiplication, B=B)  # -> simplify(Result)
intcrv = Interpolate(Vertices=ins, Degree=1, Periodic=False, KnotStyle=1)  # -> Curve, Length, Domain
offset = ClusterInput()
project = Project(Geometry=intcrv.Curve, Plane=PlaneXY(0, 0, 0))  # -> Geometry, Transform
division_3 = Division(A=heights, B=4)
ground_contour = Data(project.Geometry)
explode = Explode(Curve=ground_contour, Recursive=True)  # -> Segments, Vertices
extr = Extrude(Base=explode.Segments, Direction=graft(multiplication_2))  # -> simplify(Extrusion)
addition = Addition(A=simplify(python), B=simplify(graft(division_3)))
az = Autozoner(FloorPlanOutlines=ground_contour, Offset=offset)  # -> Outline, simplify(PerimeterPolylines), simplify(CorePolylines), SkeletonPolylines
group = Group(Objects=extr)
Z_2 = UnitZ(Factor=addition)
srf = Surface(ground_contour)
data_2 = Data(simplify(graft(heights)))
move = Move(Geometry=group, Motion=Z_2)  # -> Geometry, Transform
Z_3 = UnitZ(Factor=python)  # -> simplify(UnitVector)
Z_4 = UnitZ(Factor=data_2)
ungroup = Ungroup(Group=move.Geometry)
pcol = PolylineCollapse(Polyline=az.CorePolylines, Tolerance=1)  # -> Polyline, Count
pcol_2 = PolylineCollapse(Polyline=az.PerimeterPolylines, Tolerance=1)  # -> Polyline, Count
data_3 = Data(Z_3)
srf_2 = Surface(pcol.Polyline)
srf_3 = Surface(pcol_2.Polyline)
Z_5 = UnitZ(Factor=debox.Z)
extr_2 = Extrude(Base=srf_3, Direction=Z_4)
area = Area(Geometry=ungroup)  # -> Area, Centroid
extr_3 = Extrude(Base=srf_2, Direction=Z_4)
move_2 = Move(Geometry=srf, Motion=simplify(graft(Z_5)))  # -> Geometry, Transform
panel = Panel(division_2)
cap = CapHoles(Brep=extr_2)
cap_2 = CapHoles(Brep=extr_3)
scale = Scale(Geometry=ungroup, Center=area.Centroid, Factor=Slider(0.99, range=0..1))  # -> Geometry, Transform
group_2 = Group(Objects=cap)
group_3 = Group(Objects=cap_2)
trim = TrimTree(Tree=scale.Geometry, Depth=1)
move_3 = Move(Geometry=group_2, Motion=data_3)  # -> Geometry, Transform
move_4 = Move(Geometry=group_3, Motion=data_3)  # -> Geometry, Transform
ungroup_2 = Ungroup(Group=move_3.Geometry)  # -> simplify(Objects)
windows = ClusterOutput(trim)
ungroup_3 = Ungroup(Group=move_4.Geometry)
roof = ClusterOutput(move_2.Geometry)
ground = ClusterOutput(srf)
core = ClusterOutput(ungroup_3)
perim = ClusterOutput(ungroup_2)
