# Grasshopper definition single_shoebox.gh (Grasshopper 1.0.7)
# plug-ins: ClimateStudioGH, jSwan

number_slider = Slider(5, range=0..15)
panel = Panel("D:\Users\zoelh\GitRepos\ml-for-building-energy-modeling\ml-for-bem\data\")
python = GhPythonScript(index=number_slider, path=panel)  # -> schedules
# ---------- python: Python ----------
__author__ = "zoelh"
__version__ = "2023.11.18"

import rhinoscriptsyntax as rs
import csv
import ghpythonlib.treehelpers as th

schedules = []
l = ["EquipmentAvailabilitySchedule.csv", "LightsAvailabilitySchedule.csv", "OccupancySchedule.csv"]
for file in l:
    filename = path + file
    with open(filename) as csvfile:
        reader = csv.reader(csvfile)
        rows = list(reader)
        row = rows[int(index)+1]
        schedules.append([row[1:]])
schedules = th.list_to_tree(schedules)
# ---------- end python ----------

heatingsetpoint_degc = Slider(19, range=10..24)
ventilationperperson_l_s_person = Slider(6.9, range=0..10)
ventilationperarea_l_s_m2 = Slider(0.1, range=0..5)
coolingsetpoint_degc = Slider(25, range=16..30)
econ = ValueList({"NoEconomizer", "DifferentialEnthalpy"}, selected="NoEconomizer")
mechventon = BooleanToggle(True)
hrv = ValueList({"None", "Sensible", "Enthalpy"}, selected="Enthalpy")

bang = ExplodeTree(Data=python)  # -> Branch0, Branch1, Branch2
year_schedule = ConstructCSYearSchedule(Name="Occupancy", Type=0, Category=0, DaysHours=bang.Branch2)  # -> Sched, Values
year_schedule_2 = ConstructCSYearSchedule(Name="Equip", Type=0, Category=0, DaysHours=bang.Branch0)  # -> Sched, Values
year_schedule_3 = ConstructCSYearSchedule(Name="Lights", Type=0, Category=0, DaysHours=bang.Branch1)  # -> Sched, Values
material = ConstructCSOpaqueMaterial(
    Name="Stucco",
    Conductivity=0.72,
    Density=1856,
    Roughness="Rough",
    SpecificHeat=840,
    ThermalAbsorptance=0.9,
    SolarAbsorptance=0.7,
    VisibleAbsorptance=0.7,
    Type="Sealing",
    Input_0_Hidden=False,
    Input_0_Name="Name",
    Input_10_Hidden=True,
    Input_10_Name="TemperatureCoefficientThermalConductivity",
    Input_11_Hidden=True,
    Input_11_Name="TemperatureArray",
    Input_12_Hidden=True,
    Input_12_Name="EnthalpyArray",
    Input_13_Hidden=True,
    Input_13_Name="VariableConductivityArray",
    Input_14_Hidden=False,
    Input_14_Name="Type",
    Input_15_Hidden=True,
    Input_15_Name="EmbodiedEnergy",
    Input_16_Hidden=True,
    Input_16_Name="EmbodiedCarbon",
    Input_17_Hidden=True,
    Input_17_Name="Cost",
    Input_18_Hidden=True,
    Input_18_Name="Life",
    Input_1_Hidden=False,
    Input_1_Name="Conductivity",
    Input_2_Hidden=False,
    Input_2_Name="Density",
    Input_3_Hidden=False,
    Input_3_Name="Roughness",
    Input_4_Hidden=False,
    Input_4_Name="SpecificHeat",
    Input_5_Hidden=False,
    Input_5_Name="ThermalAbsorptance"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)
material_2 = ConstructCSOpaqueMaterial(
    Name="Plaster",
    Conductivity=1,
    Density=2000,
    Roughness="Rough",
    SpecificHeat=1130,
    ThermalAbsorptance=0.9,
    SolarAbsorptance=0.7,
    VisibleAbsorptance=0.7,
    Type="Sealing",
    Input_0_Hidden=False,
    Input_0_Name="Name",
    Input_10_Hidden=True,
    Input_10_Name="TemperatureCoefficientThermalConductivity",
    Input_11_Hidden=True,
    Input_11_Name="TemperatureArray",
    Input_12_Hidden=True,
    Input_12_Name="EnthalpyArray",
    Input_13_Hidden=True,
    Input_13_Name="VariableConductivityArray",
    Input_14_Hidden=False,
    Input_14_Name="Type",
    Input_15_Hidden=True,
    Input_15_Name="EmbodiedEnergy",
    Input_16_Hidden=True,
    Input_16_Name="EmbodiedCarbon",
    Input_17_Hidden=True,
    Input_17_Name="Cost",
    Input_18_Hidden=True,
    Input_18_Name="Life",
    Input_1_Hidden=False,
    Input_1_Name="Conductivity",
    Input_2_Hidden=False,
    Input_2_Name="Density",
    Input_3_Hidden=False,
    Input_3_Name="Roughness",
    Input_4_Hidden=False,
    Input_4_Name="SpecificHeat",
    Input_5_Hidden=False,
    Input_5_Name="ThermalAbsorptance"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)
material_3 = ConstructCSOpaqueMaterial(
    Name="Mineral Wool",
    Conductivity=0.041,
    Density=155,
    Roughness="Rough",
    SpecificHeat=1130,
    ThermalAbsorptance=0.9,
    SolarAbsorptance=0.7,
    VisibleAbsorptance=0.7,
    Type="Sealing",
    Input_0_Hidden=False,
    Input_0_Name="Name",
    Input_10_Hidden=True,
    Input_10_Name="TemperatureCoefficientThermalConductivity",
    Input_11_Hidden=True,
    Input_11_Name="TemperatureArray",
    Input_12_Hidden=True,
    Input_12_Name="EnthalpyArray",
    Input_13_Hidden=True,
    Input_13_Name="VariableConductivityArray",
    Input_14_Hidden=False,
    Input_14_Name="Type",
    Input_15_Hidden=True,
    Input_15_Name="EmbodiedEnergy",
    Input_16_Hidden=True,
    Input_16_Name="EmbodiedCarbon",
    Input_17_Hidden=True,
    Input_17_Name="Cost",
    Input_18_Hidden=True,
    Input_18_Name="Life",
    Input_1_Hidden=False,
    Input_1_Name="Conductivity",
    Input_2_Hidden=False,
    Input_2_Name="Density",
    Input_3_Hidden=False,
    Input_3_Name="Roughness",
    Input_4_Hidden=False,
    Input_4_Name="SpecificHeat",
    Input_5_Hidden=False,
    Input_5_Name="ThermalAbsorptance"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)
material_4 = ConstructCSOpaqueMaterial(
    Name="WallConcrete",
    Conductivity=2,
    Density=2400,
    Roughness="Rough",
    SpecificHeat=950,
    ThermalAbsorptance=0.9,
    SolarAbsorptance=0.7,
    VisibleAbsorptance=0.7,
    Type="Concrete",
    Input_0_Hidden=False,
    Input_0_Name="Name",
    Input_10_Hidden=True,
    Input_10_Name="TemperatureCoefficientThermalConductivity",
    Input_11_Hidden=True,
    Input_11_Name="TemperatureArray",
    Input_12_Hidden=True,
    Input_12_Name="EnthalpyArray",
    Input_13_Hidden=True,
    Input_13_Name="VariableConductivityArray",
    Input_14_Hidden=False,
    Input_14_Name="Type",
    Input_15_Hidden=True,
    Input_15_Name="EmbodiedEnergy",
    Input_16_Hidden=True,
    Input_16_Name="EmbodiedCarbon",
    Input_17_Hidden=True,
    Input_17_Name="Cost",
    Input_18_Hidden=True,
    Input_18_Name="Life",
    Input_1_Hidden=False,
    Input_1_Name="Conductivity",
    Input_2_Hidden=False,
    Input_2_Name="Density",
    Input_3_Hidden=False,
    Input_3_Name="Roughness",
    Input_4_Hidden=False,
    Input_4_Name="SpecificHeat",
    Input_5_Hidden=False,
    Input_5_Name="ThermalAbsorptance"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)
material_5 = ConstructCSOpaqueMaterial(
    Name="Felt",
    Conductivity=0.9,
    Density=0.5,
    Roughness="Rough",
    SpecificHeat=1800,
    ThermalAbsorptance=0.9,
    SolarAbsorptance=0.7,
    VisibleAbsorptance=0.7,
    Type="Sealing",
    Input_0_Hidden=False,
    Input_0_Name="Name",
    Input_10_Hidden=True,
    Input_10_Name="TemperatureCoefficientThermalConductivity",
    Input_11_Hidden=True,
    Input_11_Name="TemperatureArray",
    Input_12_Hidden=True,
    Input_12_Name="EnthalpyArray",
    Input_13_Hidden=True,
    Input_13_Name="VariableConductivityArray",
    Input_14_Hidden=False,
    Input_14_Name="Type",
    Input_15_Hidden=True,
    Input_15_Name="EmbodiedEnergy",
    Input_16_Hidden=True,
    Input_16_Name="EmbodiedCarbon",
    Input_17_Hidden=True,
    Input_17_Name="Cost",
    Input_18_Hidden=True,
    Input_18_Name="Life",
    Input_1_Hidden=False,
    Input_1_Name="Conductivity",
    Input_2_Hidden=False,
    Input_2_Name="Density",
    Input_3_Hidden=False,
    Input_3_Name="Roughness",
    Input_4_Hidden=False,
    Input_4_Name="SpecificHeat",
    Input_5_Hidden=False,
    Input_5_Name="ThermalAbsorptance"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)
material_6 = ConstructCSOpaqueMaterial(
    Name="Concrete",
    Conductivity=2,
    Density=2100,
    Roughness="Rough",
    SpecificHeat=1040,
    ThermalAbsorptance=0.9,
    SolarAbsorptance=0.7,
    VisibleAbsorptance=0.7,
    Type="Concrete",
    Input_0_Hidden=False,
    Input_0_Name="Name",
    Input_10_Hidden=True,
    Input_10_Name="TemperatureCoefficientThermalConductivity",
    Input_11_Hidden=True,
    Input_11_Name="TemperatureArray",
    Input_12_Hidden=True,
    Input_12_Name="EnthalpyArray",
    Input_13_Hidden=True,
    Input_13_Name="VariableConductivityArray",
    Input_14_Hidden=False,
    Input_14_Name="Type",
    Input_15_Hidden=True,
    Input_15_Name="EmbodiedEnergy",
    Input_16_Hidden=True,
    Input_16_Name="EmbodiedCarbon",
    Input_17_Hidden=True,
    Input_17_Name="Cost",
    Input_18_Hidden=True,
    Input_18_Name="Life",
    Input_1_Hidden=False,
    Input_1_Name="Conductivity",
    Input_2_Hidden=False,
    Input_2_Name="Density",
    Input_3_Hidden=False,
    Input_3_Name="Roughness",
    Input_4_Hidden=False,
    Input_4_Name="SpecificHeat",
    Input_5_Hidden=False,
    Input_5_Name="ThermalAbsorptance"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)
material_7 = ConstructCSOpaqueMaterial(
    Name="AcousticTile",
    Conductivity=0.06,
    Density=368,
    Roughness="Rough",
    SpecificHeat=590,
    ThermalAbsorptance=0.9,
    SolarAbsorptance=0.7,
    VisibleAbsorptance=0.7,
    Type="Finishes",
    Input_0_Hidden=False,
    Input_0_Name="Name",
    Input_10_Hidden=True,
    Input_10_Name="TemperatureCoefficientThermalConductivity",
    Input_11_Hidden=True,
    Input_11_Name="TemperatureArray",
    Input_12_Hidden=True,
    Input_12_Name="EnthalpyArray",
    Input_13_Hidden=True,
    Input_13_Name="VariableConductivityArray",
    Input_14_Hidden=False,
    Input_14_Name="Type",
    Input_15_Hidden=True,
    Input_15_Name="EmbodiedEnergy",
    Input_16_Hidden=True,
    Input_16_Name="EmbodiedCarbon",
    Input_17_Hidden=True,
    Input_17_Name="Cost",
    Input_18_Hidden=True,
    Input_18_Name="Life",
    Input_1_Hidden=False,
    Input_1_Name="Conductivity",
    Input_2_Hidden=False,
    Input_2_Name="Density",
    Input_3_Hidden=False,
    Input_3_Name="Roughness",
    Input_4_Hidden=False,
    Input_4_Name="SpecificHeat",
    Input_5_Hidden=False,
    Input_5_Name="ThermalAbsorptance"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)
material_8 = ConstructCSOpaqueMaterial(
    Name="XPS",
    Conductivity=0.034,
    Density=35,
    Roughness="Rough",
    SpecificHeat=1400,
    ThermalAbsorptance=0.9,
    SolarAbsorptance=0.7,
    VisibleAbsorptance=0.7,
    Type="Insulation",
    Input_0_Hidden=False,
    Input_0_Name="Name",
    Input_10_Hidden=True,
    Input_10_Name="TemperatureCoefficientThermalConductivity",
    Input_11_Hidden=True,
    Input_11_Name="TemperatureArray",
    Input_12_Hidden=True,
    Input_12_Name="EnthalpyArray",
    Input_13_Hidden=True,
    Input_13_Name="VariableConductivityArray",
    Input_14_Hidden=False,
    Input_14_Name="Type",
    Input_15_Hidden=True,
    Input_15_Name="EmbodiedEnergy",
    Input_16_Hidden=True,
    Input_16_Name="EmbodiedCarbon",
    Input_17_Hidden=True,
    Input_17_Name="Cost",
    Input_18_Hidden=True,
    Input_18_Name="Life",
    Input_1_Hidden=False,
    Input_1_Name="Conductivity",
    Input_2_Hidden=False,
    Input_2_Name="Density",
    Input_3_Hidden=False,
    Input_3_Name="Roughness",
    Input_4_Hidden=False,
    Input_4_Name="SpecificHeat",
    Input_5_Hidden=False,
    Input_5_Name="ThermalAbsorptance"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)

# ----
# Run Analysis
button = Button()

datetime_string = GhPythonScript(run=button)  # -> dt
# ---------- datetime_string: Python ----------
__author__ = "zoelh"
__version__ = "2023.11.18"

import rhinoscriptsyntax as rs
import time
if run:
    dt = b=time.strftime("%y%m%d_%H%M%S", time.localtime())
# ---------- end datetime_string ----------

infiltrationmethod = ValueList({"ACH", "Flow Per Exterior Area": "FlowExtArea"}, selected="Flow Per Exterior Area")
infiltration_m3_s_m2 = Slider(5e-05, range=0..0.0005)
infiltration_ach = Slider(0, range=0..1)

# ---- group: Loads
lpd_w_m2 = Slider(4.1, range=0..50)
epd_w_m2 = Slider(12.3, range=0..50)
peopledensity_ppl_m2 = Slider(0.025, range=0..0.5)

# ---- group: Windows
number_slider_2 = Slider(0.5, range=0..1)
number_slider_3 = Slider(2.89, range=0.6..7)
tvis = Panel("0.75")

# ----
filename = Panel("Shoebox")
output_directory = Panel("D:\DATA\SingleShoeboxTests\")

# ---- group: Ground Slab
list = ValueList({"UVal_0.4", "UVal_0.3", "UVal_0.2", "UVal_0.1"}, selected="UVal_0.2")
list_2 = ValueList({"Light": "_Light", "Mass": "_Mass"}, selected="Light")

# ----
# Input Geometry
orientation = Slider(0, range=0..6.283)
ground = BooleanToggle(False)
roof = BooleanToggle(False)
width = Slider(3, range=0..10)
height = Slider(4, range=0..10)
core_depth = Slider(7, range=0..10)
wwr = Slider(0.3, range=0..1)
perim_depth = Slider(3, range=0..10)
cluster = Cluster(
    core_depth=core_depth,
    floor=ground,
    perim_depth=perim_depth,
    width=width,
    roof=roof,
    height=height,
    orientation=orientation,
    wwr=wwr)  # -> perimeter_2, core_2, window_2, ground_3, adiabatic_3
adiabatic = Data(cluster.adiabatic_3)
perim = Data(cluster.perimeter_2)
core = Data(cluster.core_2)
window = Data(cluster.window_2)
ground_2 = Data(cluster.ground_3)

epw = Panel("C:\ProgramData\Solemma\Common\WeatherData\EPW\USA_MA_Boston-Logan.Intl.AP.725090_TMYx.2004-2018.epw")
filename_2 = Panel("Shoebox_sched3")
occupancy = Data(year_schedule.Sched)

# ---- group: MechVentilationSchedule
panel_2 = Panel("AllOn")

# ---- group: WallInsul
layer = ConstructCSLayer(Material=material_2, Thickness="0.013")

layer_2 = ConstructCSLayer(Material=material, Thickness="0.025")

# ---- group: RoofFelt
layer_3 = ConstructCSLayer(Material=material_5, Thickness="0.003")

# ---- group: RoofTile
layer_4 = ConstructCSLayer(Material=material_7, Thickness="0.005")

# ----
merge = Merge(Data1=list, Data2=list_2)
list_3 = ValueList({"Residential", "Kitchen", "Office", "MeetingRoom", "HotelRoom", "ClassRoom", "Library", "LectureHall", "SuperMarket", "Shopping", "ScienceLab"}, selected="Office")
simple_window = ConstructCSSimpleWindow(Name="windowtest", Shgf=number_slider_2, Uval=number_slider_3, Tvis=tvis)
zonetemplate = GetZoneTemplate(SearchZoneTemplate=list_3, Selection="Office")
heating_coolingconstant = BooleanToggle(True)
scheduledventilationon = BooleanToggle(False)

# ----
# Boundary condition setup
bco = CSBoundaryObject(Brep=ground_2, type="GROUND")
bco_2 = CSBoundaryObject(Brep=adiabatic, type="ADIABAT")

join = TextJoin(Text=merge)
people_equip_lightson = BooleanToggle(True)

panel_3 = Panel("Airspeed")
sched = GetCSYearSchedule(UnitSystem=4)

heating_coolingon = BooleanToggle(True)
humidistaton = BooleanToggle(False)
infiltrationon = BooleanToggle(True)
item = ListItem(List=zonetemplate, Index=0, Wrap=True)
natventon = BooleanToggle(False)
fanenergy = BooleanToggle(False)
dhwon = BooleanToggle(True)
shadingon = BooleanToggle(False)
hasframe = BooleanToggle(False)
construction = GetCSConstruction(SearchConstructions=join)
dimmingtype = Panel("Off")
wset = CSWindowSettings(
    Name="SimpleWindowSettings",
    Type="External",
    ShadingSystemIsOn=shadingon,
    GlazingConstruction=simple_window,
    OperableArea="0",
    HasFrame=hasframe,
    AFNWindowAvailability="AllOff",
    Input_0_Hidden=False,
    Input_0_Name="Name",
    Input_10_Hidden=True,
    Input_10_Name="ShadingThickness",
    Input_11_Hidden=True,
    Input_11_Name="ShadeGlassDistance",
    Input_12_Hidden=True,
    Input_12_Name="TopBottomEdgeOpeningMultiplier",
    Input_13_Hidden=True,
    Input_13_Name="Analysis Mesh Resolution",
    Input_14_Hidden=True,
    Input_14_Name="ZoneMixingIsOn",
    Input_15_Hidden=True,
    Input_15_Name="ZoneMixingDeltaTemperature",
    Input_16_Hidden=True,
    Input_16_Name="ZoneMixingFlowRate",
    Input_17_Hidden=False,
    Input_17_Name="Glazing Construction",
    Input_18_Hidden=False,
    Input_18_Name="OperableArea",
    Input_19_Hidden=True,
    Input_19_Name="ZoneMixingAvailibilitySchedule",
    Input_1_Hidden=False,
    Input_1_Name="WindowSettings",
    Input_20_Hidden=False,
    Input_20_Name="HasFrame",
    Input_21_Hidden=True,
    Input_21_Name="FrameWidth",
    Input_22_Hidden=True,
    Input_22_Name="FrameProjection"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)

# ----
# Window
window_2 = Window(Surface=window, Settings=wset, UsedLibraryObjects="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")  # -> Window, Settings

python_2 = GhPythonScript(w=width, h=height, pd=perim_depth, cd=core_depth, r=roof, g=ground, wwr=wwr, o=orientation, sched=number_slider)  # -> d
# ---------- python_2: Python ----------
__author__ = "zoelh"
__version__ = "2023.11.18"

import rhinoscriptsyntax as rs
import json

d= dict(
    ShoeboxConfig=dict(
        width=w,
        height=h,
        perim_depth=pd,
        core_depth=cd,
        adiabatic_partition_flag=0,
        roof_2_footprint=1 if r else 0,
        ground_2_footprint=1 if g else 0,
        wwr=wwr,
        orientation=o,
        shading_vect=[0]*12,
        schedule_index=int(sched)
    )
)
d = json.dumps(d)
print(d)
# ---------- end python_2 ----------
python_3 = GhPythonScript(name="windowtest", shgc=number_slider_2, uval=number_slider_3, tvis=tvis)  # -> d
# ---------- python_3: Python ----------
__author__ = "zoelh"
__version__ = "2023.11.18"

import rhinoscriptsyntax as rs
import json

d= dict(
    SimpleWindow=dict(
        Name=name,
        shgc=shgc,
        uval=uval,
        tvis=tvis,
    )
)
d = json.dumps(d)
print(d)
# ---------- end python_3 ----------
panel_4 = Panel(construction)
jmerge = MergeJson(SourceJson=python_3, OverrideJson=python_2)
construction_2 = GetCSConstruction()
panel_5 = Panel("""Core C, CS
Perim C, CS
Core H, CS
Perim H, CS
Core H, wb
Core C, wb
Perim H, wb
Perim C, wb
Core H, surr
Core C, surr
Perim H, surr
Perim C, surr""")
fetch_results = Button()
panel_6 = Panel("""6
6
6
6
6
6
6
6
6
6
6
6""")
expression = Expression(x=filename, Expression="Format(\"{0} Loads, by zone\", x)")
merge_2 = Merge(
    Data1=ColourSwatch(SwatchColor=RGB(0, 123, 255)),
    Data2=ColourSwatch(SwatchColor=RGB(157, 0, 255)),
    Data3=ColourSwatch(SwatchColor=RGB(255, 0, 0)),
    Data4=ColourSwatch(SwatchColor=RGB(255, 157, 0)),
    Data5=ColourSwatch(SwatchColor=RGB(112, 0, 0)),
    Data6=ColourSwatch(SwatchColor=RGB(0, 4, 212)),
    Data7=ColourSwatch(SwatchColor=RGB(255, 0, 242)),
    Data8=ColourSwatch(SwatchColor=RGB(0, 255, 0)),
    Data9=ColourSwatch(SwatchColor=RGB(255, 82, 82)),
    Data10=ColourSwatch(SwatchColor=RGB(135, 193, 255)),
    Data11=ColourSwatch(SwatchColor=RGB(255, 176, 92)),
    Data12=ColourSwatch(SwatchColor=RGB(206, 128, 255)))
toggle = BooleanToggle(True)
expression_2 = Expression(x=filename, Expression="Format(\"{0}_surrogate_out.csv\", x)")
expression_3 = Expression(x=filename, Expression="Format(\"{0}_whitebox_out.csv\", x)")
expression_4 = Expression(x=filename, Expression="Format(\"{0} Loads, total\", x)")
addition = Addition(A=core_depth, B=perim_depth)
multiplication = Multiplication(A=core_depth, B=width)
python_4 = GhPythonScript(name=expression_2, path=output_directory, fetch=fetch_results)  # -> simplify(data)
# ---------- python_4: Python ----------
__author__ = "zoelh"
__version__ = "2023.11.18"

import rhinoscriptsyntax as rs
import csv
import ghpythonlib.treehelpers as th

filename = path + name
print(filename)
with open(filename) as csvfile:
    reader = csv.reader(csvfile)
    rows = list(reader)
if fetch:
    with open(filename) as csvfile:
        reader = csv.reader(csvfile)
        rows = list(reader)

data = th.list_to_tree(rows)
# ---------- end python_4 ----------
python_5 = GhPythonScript(name=expression_3, path=output_directory, fetch=fetch_results)  # -> simplify(data); same code as python_4
multiplication_2 = Multiplication(A=addition, B=width)
division = Division(A=multiplication, B=multiplication_2)
flip = FlipMatrix(Data=python_4)
flip_2 = FlipMatrix(Data=python_5)
merge_3 = Merge(Data1=multiplication_2, Data2=multiplication)  # -> simplify(graft(Result))
core_weight = Data(division)
panel_7 = Panel("""Cooling, CS
Heating, CS
Cooling, WB
Heating, WB
Cooling, surr
Heating, surr""")
dup = DuplicateData(Data=core_weight, Number=2, Order=True)
subtraction = Subtraction(A=1, B=core_weight)
dup_2 = DuplicateData(Data=core_weight, Number=2, Order=True)
perim_weight = Data(subtraction)
dup_3 = DuplicateData(Data=perim_weight, Number=2, Order=True)
dup_4 = DuplicateData(Data=perim_weight, Number=2, Order=True)
merge_4 = Merge(Data1=dup, Data2=dup_3)  # -> simplify(graft(Result))
merge_5 = Merge(Data1=dup_2, Data2=dup_4)  # -> simplify(graft(Result))
merge_6 = Merge(Data1=core_weight, Data2=perim_weight)  # -> simplify(graft(Result))
multiplication_3 = Multiplication(A=python_4, B=merge_4)
multiplication_4 = Multiplication(A=python_5, B=merge_5)
bang_2 = ExplodeTree(Data=multiplication_3)  # -> Branch0, Branch1, Branch2, Branch3
bang_3 = ExplodeTree(Data=multiplication_4)  # -> Branch0, Branch1, Branch2, Branch3
merge_7 = Merge(
    Data1=ColourSwatch(SwatchColor=RGB(0, 123, 255)),
    Data2=ColourSwatch(SwatchColor=RGB(255, 0, 0)),
    Data3=ColourSwatch(SwatchColor=RGB(0, 4, 212)),
    Data4=ColourSwatch(SwatchColor=RGB(255, 157, 0)),
    Data5=ColourSwatch(SwatchColor=RGB(0, 255, 0)),
    Data6=ColourSwatch(SwatchColor=RGB(255, 82, 82)))
addition_2 = Addition(A=bang_2.Branch1, B=bang_2.Branch3)
addition_3 = Addition(A=bang_2.Branch0, B=bang_2.Branch2)
addition_4 = Addition(A=bang_3.Branch1, B=bang_3.Branch3)
addition_5 = Addition(A=bang_3.Branch0, B=bang_3.Branch2)
number_slider_4 = Slider(13, range=0..50)
merge_8 = Merge(Data1=graft(addition_2), Data2=graft(addition_3))  # -> simplify(Result)
merge_9 = Merge(Data1=graft(addition_4), Data2=graft(addition_5))  # -> simplify(Result)
panel_8 = Panel("""Heating
Cooling""")
panel_9 = Panel("""Core C, CS
Perim C, CS
Core H, CS
Perim H, CS
Core H, surr
Core C, surr
Perim H, surr
Perim C, surr""")
trim = TrimTree(Tree=merge_8, Depth=1)
trim_2 = TrimTree(Tree=merge_9, Depth=1)
panel_10 = Panel(merge_6)
flip_3 = FlipMatrix(Data=trim_2)
flip_4 = FlipMatrix(Data=trim)
panel_11 = Panel("""Core H, wb
Core C, wb
Perim H, wb
Perim C, wb""")
merge_10 = Merge(
    Data1=ColourSwatch(SwatchColor=RGB(255, 0, 0)),
    Data2=ColourSwatch(SwatchColor=RGB(0, 123, 255)),
    Data3=ColourSwatch(SwatchColor=RGB(255, 157, 0)),
    Data4=ColourSwatch(SwatchColor=RGB(157, 0, 255)))
merge_11 = Merge(
    Data1=ColourSwatch(SwatchColor=RGB(0, 123, 255)),
    Data2=ColourSwatch(SwatchColor=RGB(255, 0, 0)),
    Data3=ColourSwatch(SwatchColor=RGB(255, 157, 0)),
    Data4=ColourSwatch(SwatchColor=RGB(157, 0, 255)))

# ---- group: FACADE CONSTRUCTION
wall_concrete_thickness = Panel("0.203")
wall_insul_thickness = Panel("0.194")

# ---- group: WallConcrete
layer_5 = ConstructCSLayer(Material=material_4, Thickness=wall_concrete_thickness)

# ---- group: ROOF CONSTRUCTION
roof_concrete_thickness = Panel("0.203")
roof_xps_thickness = Panel("0.16")

# ---- group: WallInsul
layer_6 = ConstructCSLayer(Material=material_3, Thickness=roof_xps_thickness)

# ---- group: RoofConcrete
layer_7 = ConstructCSLayer(Material=material_6, Thickness=roof_concrete_thickness)

# ---- group: RoofXPS
layer_8 = ConstructCSLayer(Material=material_8, Thickness=roof_xps_thickness)

# ----
construction_3 = ConstructCSConstruction(
    Name="ExteriorRoof",
    Category="Roof",
    Layers=flatten([layer_8, layer_7, layer_4, layer_3]),
    Input_0_Hidden=False,
    Input_0_Name="Name",
    Input_1_Hidden=False,
    Input_1_Name="Category",
    Input_2_Hidden=False,
    Input_2_Name="Layers",
    Input_3_Hidden=True,
    Input_3_Name="EmbodiedEnergy",
    Input_4_Hidden=True,
    Input_4_Name="EmbodiedCarbon",
    Input_5_Hidden=True,
    Input_5_Name="Cost",
    Input_6_Hidden=True,
    Input_6_Name="Life",
    UnitSystem=4,
    Input_3_GHParam_Branch0_Path="{0}",
    Input_3_GHParam_Branch0_Item0_number=0,
    Input_4_GHParam_Branch0_Path="{0}",
    Input_4_GHParam_Branch0_Item0_number=0,
    Input_5_GHParam_Branch0_Path="{0}",
    Input_5_GHParam_Branch0_Item0_number=0,
    Input_6_GHParam_Branch0_Path="{0}",
    Input_6_GHParam_Branch0_Item0_number=10)  # -> Construction, ConstructionInformation

# ---- group: ROOF CONSTRUCTION (continued)
panel_12 = Panel(construction_3.ConstructionInformation)
exteriorroof = Data(construction_3.Construction)

# ----
construction_4 = ConstructCSConstruction(
    Name="ExteriorWall",
    Category="Roof",
    Layers=flatten([layer_5, layer_6, layer, layer_2]),
    Input_0_Hidden=False,
    Input_0_Name="Name",
    Input_1_Hidden=False,
    Input_1_Name="Category",
    Input_2_Hidden=False,
    Input_2_Name="Layers",
    Input_3_Hidden=True,
    Input_3_Name="EmbodiedEnergy",
    Input_4_Hidden=True,
    Input_4_Name="EmbodiedCarbon",
    Input_5_Hidden=True,
    Input_5_Name="Cost",
    Input_6_Hidden=True,
    Input_6_Name="Life",
    UnitSystem=4,
    Input_3_GHParam_Branch0_Path="{0}",
    Input_3_GHParam_Branch0_Item0_number=0,
    Input_4_GHParam_Branch0_Path="{0}",
    Input_4_GHParam_Branch0_Item0_number=0,
    Input_5_GHParam_Branch0_Path="{0}",
    Input_5_GHParam_Branch0_Item0_number=0,
    Input_6_GHParam_Branch0_Path="{0}",
    Input_6_GHParam_Branch0_Item0_number=10)  # -> Construction, ConstructionInformation

# ---- group: FACADE CONSTRUCTION (continued)
panel_13 = Panel(construction_4.ConstructionInformation)
exteriorwall = Data(construction_4.Construction)

# ----
zset = CSZoneSettings(
    Name="ParametricZoneSettings",
    ZoneSettings=item,
    RoofConstruction=exteriorroof,
    FacadeConstruction=exteriorwall,
    SlabConstruction=construction,
    PartitionConstruction="defaultConstruction",
    ExternalFloorConstruction=construction,
    InternalMassConstruction="defaultConstruction",
    InternalMassExposedArea=Slider(0, range=0..1),
    GroundSlabConstruction=construction,
    PeopleDensity=peopledensity_ppl_m2,
    AirspeedSchedule="AirSpeed 0",
    EquipmentPowerDensity=epd_w_m2,
    LightingPowerDensity=lpd_w_m2,
    OccupancySchedule=year_schedule.Sched,
    EquipmentAvailabilitySchedule=year_schedule_2.Sched,
    LightsAvailabilitySchedule=year_schedule_3.Sched,
    DimmingType=dimmingtype,
    PeopleIsOn=people_equip_lightson,
    EquipmentIsOn=people_equip_lightson,
    LightsIsOn=people_equip_lightson,
    CoolingCOP=Slider(1, range=0.6..6),
    HeatingCOP=Slider(1, range=0.6..6),
    HeatingSetpoint=heatingsetpoint_degc,
    CoolingSetpoint=coolingsetpoint_degc,
    HeatingSetpointConstant=heating_coolingconstant,
    CoolingSetpointConstant=heating_coolingconstant,
    HeatIsOn=heating_coolingon,
    CoolIsOn=heating_coolingon,
    MechVentIsOn=mechventon,
    HumidistatIsOn=humidistaton,
    HeatingLimitType="NoLimit",
    CoolingLimitType="LimitFlowRateAndCapacity",
    HeatingSchedule="AllOn",
    CoolingSchedule="AllOn",
    MechVentSchedule=occupancy,
    MinFreshAirPerson=ventilationperperson_l_s_person,
    MinFreshAirArea=ventilationperarea_l_s_m2,
    EconomizerType=econ,
    HeatRecoveryType=hrv,
    HeatRecoveryEfficiencySensible="0.7",
    HeatRecoveryEfficiencyLatent="0.65",
    MinHumidity="20",
    MaxHumidity="80",
    TurnOnEMSFanEnergy=fanenergy,
    MaxHeatSupplyAirTemp="30",
    MinCoolSupplyAirTemp="18",
    NatVentIsOn=natventon,
    SchedVentIsOn=scheduledventilationon,
    InfiltrationIsOn=infiltrationon,
    InfiltrationAch=infiltration_ach,
    InfiltrationFlowExtArea=infiltration_m3_s_m2,
    InfiltrationCalculationMethod=infiltrationmethod,
    FlowRatePerPerson="0",
    DHWOn=dhwon,
    Input_0_Hidden=False,
    Input_0_Name="Name",
    Input_100_Hidden=True,
    Input_100_Name="Interior Vertical Insulation Depth",
    Input_101_Hidden=True,
    Input_101_Name="Exterior Horizontal Insulation Depth",
    Input_102_Hidden=True,
    Input_102_Name="Exterior Horizontal Insulation Width",
    Input_103_Hidden=True,
    Input_103_Name="Footing Thickness",
    Input_104_Hidden=True,
    Input_104_Name="Footing Depth",
    Input_105_Hidden=True,
    Input_105_Name="ElectricityCO2",
    Input_106_Hidden=True,
    Input_106_Name="ElectricityCost",
    Input_107_Hidden=True,
    Input_107_Name="HotWaterCO2",
    Input_108_Hidden=True,
    Input_108_Name="HotWaterCost",
    Input_109_Hidden=True,
    Input_109_Name="CoolingCO2",
    Input_10_Hidden=True,
    Input_10_Name="Ground Wall Construction",
    Input_110_Hidden=True,
    Input_110_Name="HeatingCO2",
    Input_111_Hidden=True,
    Input_111_Name="CoolingCost",
    Input_112_Hidden=True,
    Input_112_Name="HeatingCost"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)

# ----
# Zone Settings
zone = ThermalZone(Brep=core, Name="Core", Settings=zset, UsedLibraryObjects="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")  # -> Zones, Settings
zone_2 = ThermalZone(Brep=perim, Name="Perimeter", Settings=zset, UsedLibraryObjects="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")  # -> Zones, Settings

library = CSLibrary(AddObjects=flatten([year_schedule_2.Sched, year_schedule_3.Sched, year_schedule.Sched, simple_window, exteriorroof, exteriorwall]))

# ----
# Simulate
networker = Networker(
    Zones=flatten([zone.Zones, zone_2.Zones]),
    Windows=window_2.Window,
    Boundaries=flatten([bco, bco_2]),
    Library=library,
    preview_displayAdia=True,
    preview_displayExtFloor=True,
    preview_displayFacades=True,
    preview_displayGround=True,
    preview_displayParts=True,
    preview_displayRoofs=True,
    preview_displayShade=True,
    preview_displaySlabs=True,
    preview_displayWins=True)
run_e = RunCSEnergyModel(
    Model=networker,
    Name=filename,
    Directory=output_directory,
    Location=epw,
    Run=button,
    settings="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")  # -> Model, Settings, Result

demodel = DeconstructCSEnergyModel(
    Model=networker,
    Output_0_Hidden=False,
    Output_0_Name="Facade",
    Output_10_Hidden=False,
    Output_10_Name="Adiabatic Roof",
    Output_11_Hidden=False,
    Output_11_Name="Window",
    Output_12_Hidden=False,
    Output_12_Name="Internal Window",
    Output_13_Hidden=False,
    Output_13_Name="Shading",
    Output_14_Hidden=True,
    Output_14_Name="Face ID",
    Output_15_Hidden=True,
    Output_15_Name="ID Location",
    Output_16_Hidden=True,
    Output_16_Name="Area",
    Output_17_Hidden=True,
    Output_17_Name="Zone Settings",
    Output_18_Hidden=True,
    Output_18_Name="Window Settings",
    Output_19_Hidden=True,
    Output_19_Name="Internal Window Settings",
    Output_1_Hidden=False,
    Output_1_Name="Partition",
    Output_2_Hidden=False,
    Output_2_Name="Ceiling",
    Output_3_Hidden=False,
    Output_3_Name="Roof",
    Output_4_Hidden=False,
    Output_4_Name="External Floor"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)  # -> Facade, Partition, Ceiling, Roof, ExternalFloor, Floor, FloorGround, WallGround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
panel_14 = Panel(zset)
jmerge_2 = MergeJson(SourceJson=zset, OverrideJson=jmerge)
python_6 = GhPythonScript(set=jmerge_2, name=filename, dir=output_directory, save=button)
# ---------- python_6: Python ----------
__author__ = "zoelh"
__version__ = "2023.11.18"

import rhinoscriptsyntax as rs
import json

if save:
    fname = dir + name + ".json"
    print(fname)
    with open(fname, "w") as f:
        json.dump(json.loads(set), f, indent=4)
# ---------- end python_6 ----------
load_zone_results = LoadCSZoneResults(
    ThermalModel=run_e.Model,
    Toggle=toggle,
    byzone="True",
    settings="""{
  "zoneIDs": [],
  "output2Display": [
    {
      "key": "Zone Ideal Loads Zone Total Heating Energy",
      "unit": "HVAC Sum [J]",
      "type": 0
    }
  ],
  "normalizeByFloorArea": false
}""")  # -> ResultsPerZone, Labels, Name, Zone
load_zone_results_2 = LoadCSZoneResults(
    ThermalModel=run_e.Model,
    Toggle=toggle,
    byzone="True",
    settings="""{
  "zoneIDs": [],
  "output2Display": [
    {
      "key": "Zone Ideal Loads Zone Total Cooling Energy",
      "unit": "HVAC Sum [J]",
      "type": 0
    }
  ],
  "normalizeByFloorArea": false
}""")  # -> ResultsPerZone, Labels, Name, Zone
panel_15 = Panel(load_zone_results.Labels)
panel_16 = Panel(load_zone_results_2.Labels)
panel_17 = Panel(load_zone_results.Name)
panel_18 = Panel(load_zone_results_2.Name)
joules_to_kw = JoulesToKW(A=load_zone_results.ResultsPerZone)
joules_to_kw_2 = JoulesToKW(A=load_zone_results_2.ResultsPerZone)
python_7 = GhPythonScript(x=joules_to_kw_2)  # -> monthly, months; inputs x: list
# ---------- python_7: Python ----------
__author__ = "zoelh"
__version__ = "2023.11.18"

import rhinoscriptsyntax as rs

month_map = {
    "Jan": 744,
    "Feb": 672,
    "Mar": 744,
    "Apr": 720,
    "May": 744,
    "Jun": 720,
    "Jul": 744,
    "Aug": 744,
    "Sep": 720,
    "Oct": 744,
    "Nov": 720,
    "Dec": 744,
}

monthly = []
months = list(month_map.keys())
c=0
for _, hours in month_map.items():
    m = sum(x[c : c + hours])
    print(m)
    monthly.append(m)
    c += hours
# ---------- end python_7 ----------
python_8 = GhPythonScript(x=joules_to_kw)  # -> monthly, months; inputs x: list; same code as python_7
ma = MassAddition(Input=python_8.monthly)  # -> Result, PartialResults
division_2 = Division(A=python_7.monthly, B=merge_3)
ma_2 = MassAddition(Input=division_2)  # -> Result, PartialResults
bang_4 = ExplodeTree(Data=ma_2.Result)  # -> Branch0, Branch1
bang_5 = ExplodeTree(Data=ma.Result)  # -> Branch0, Branch1
division_3 = Division(A=python_8.monthly, B=merge_3)
flip_5 = FlipMatrix(Data=division_3)
flip_6 = FlipMatrix(Data=division_2)
core_cooling_eui_kwh_m2_a = Panel(bang_4.Branch0)
core_heating_eui_kwh_m2_a = Panel(bang_5.Branch0)
perim_cooling_eui_kwh_m2_a = Panel(bang_4.Branch1)
perim_heating_eui_kwh_m2_a = Panel(bang_5.Branch1)
multiplication_5 = Multiplication(A=division_2, B=merge_6)
multiplication_6 = Multiplication(A=division_3, B=merge_6)
merge_12 = Merge(Data1=flip_6, Data2=flip_5)
bang_6 = ExplodeTree(Data=multiplication_5)  # -> Branch0, Branch1
bang_7 = ExplodeTree(Data=multiplication_6)  # -> Branch0, Branch1
merge_13 = Merge(Data1=merge_12, Data2=flip_2, Data3=flip)
addition_6 = Addition(A=bang_6.Branch0, B=bang_6.Branch1)
addition_7 = Addition(A=bang_7.Branch0, B=bang_7.Branch1)
merge_14 = Merge(Data1=graft(addition_6), Data2=graft(addition_7))  # -> simplify(Result)
flip_7 = FlipMatrix(Data=merge_13)
plotter = CSPlotter(
    Type=0,
    Width=550,
    Height=450,
    Title=expression,
    Y_title="Cooling Demand (kWh/m2)",
    X_rot=0,
    Y_data=flip_7,
    Colors=merge_2,
    Names=panel_5,
    Range=Slider(18, range=0..50),
    Show_xgrid=False,
    Show_ygrid=True,
    Legend=0,
    PreviewDimension=1,
    InfinateZoomDisplay=True,
    UnitSystem=4)
flip_8 = FlipMatrix(Data=merge_12)
flip_9 = FlipMatrix(Data=merge_14)
xyplot = XYPlot(
    Type=2,
    Width=550,
    Height=450,
    Title="Shoebox Loads - ClimateStudio",
    X_labels=python_7.months,
    X_rot=0,
    Y_data=flip_9,
    Colors=merge_11,
    Names=panel_8,
    Range=number_slider_4,
    Show_xgrid=False,
    Show_ygrid=True,
    Legend=0)
xyplot_2 = XYPlot(
    Type=2,
    Width=550,
    Height=450,
    Title="Shoebox Loads - ClimateStudio",
    X_labels=python_7.months,
    X_rot=0,
    Y_data=flip_8,
    Colors=merge_2,
    Names=panel_9,
    Range=number_slider_4,
    Show_xgrid=False,
    Show_ygrid=True,
    Legend=0)
merge_15 = Merge(Data1=merge_14, Data2=flip_3, Data3=flip_4)
flip_10 = FlipMatrix(Data=merge_15)
plotter_2 = CSPlotter(
    Type=0,
    Width=550,
    Height=450,
    Title=expression_4,
    Y_title="Cooling Demand (kWh/m2)",
    X_rot=0,
    Y_data=flip_10,
    Colors=merge_7,
    Names=panel_7,
    Range=Slider(9, range=0..50),
    Show_xgrid=False,
    Show_ygrid=True,
    Legend=0,
    PreviewDimension=1,
    InfinateZoomDisplay=True,
    UnitSystem=4)
xyplot_3 = XYPlot(
    Type=2,
    Width=550,
    Height=450,
    Title="Shoebox Loads - Whitebox",
    X_labels=python_7.months,
    X_rot=0,
    Y_data=trim_2,
    Colors=merge_11,
    Names=panel_8,
    Range=number_slider_4,
    Show_xgrid=False,
    Show_ygrid=True,
    Legend=0)
xyplot_4 = XYPlot(
    Type=2,
    Width=550,
    Height=450,
    Title="Shoebox Loads - Whitebox",
    X_labels=python_7.months,
    X_rot=0,
    Y_data=python_5,
    Colors=merge_10,
    Names=panel_11,
    Range=number_slider_4,
    Show_xgrid=False,
    Show_ygrid=True,
    Legend=0)
xyplot_5 = XYPlot(
    Type=2,
    Width=550,
    Height=450,
    Title="Shoebox Loads - Surrogate",
    X_labels=python_7.months,
    X_rot=0,
    Y_data=trim,
    Colors=merge_11,
    Names=panel_8,
    Range=number_slider_4,
    Show_xgrid=False,
    Show_ygrid=True,
    Legend=0)
xyplot_6 = XYPlot(
    Type=2,
    Width=550,
    Height=450,
    Title="Shoebox Loads - Surrogate",
    X_labels=python_7.months,
    X_rot=0,
    Y_data=python_4,
    Colors=merge_10,
    Names=panel_11,
    Range=number_slider_4,
    Show_xgrid=False,
    Show_ygrid=True,
    Legend=0)

# ==== cluster Cluster
perim_depth = ClusterInput()
core_depth = ClusterInput()
orientation = ClusterInput()
width = ClusterInput()
height = ClusterInput()
neg = Negative(Value=core_depth)
wwr = ClusterInput()
Z = UnitZ(Factor=height)
pt = ConstructPoint(XCoordinate=perim_depth, YCoordinate=width, ZCoordinate=0)
pt_2 = ConstructPoint(XCoordinate=neg, YCoordinate=width, ZCoordinate=0)
pt_3 = ConstructPoint(XCoordinate=0, YCoordinate=width, ZCoordinate=height)
pt_4 = ConstructPoint(XCoordinate=0, YCoordinate=width, ZCoordinate=height)
xz = XZPlane(Origin=Point(0, 0, 0))
xz_2 = XZPlane(Origin=Point(0, 0, 0))
multiplication = Multiplication(A=height, B=wwr)
rec_2pt = Rectangle2Pt(Plane=PlaneXY(0, 0, 0), PointA=Point(0, 0, 0), PointB=pt, Radius=0)  # -> Rectangle, Length
rec_2pt_2 = Rectangle2Pt(Plane=xz, PointA=pt_3, PointB=pt_2, Radius=0)  # -> Rectangle, Length
rec_2pt_3 = Rectangle2Pt(Plane=PlaneXY(0, 0, 0), PointA=Point(0, 0, 0), PointB=pt_2, Radius=0)  # -> Rectangle, Length
rec_2pt_4 = Rectangle2Pt(Plane=xz_2, PointA=pt_4, PointB=pt, Radius=0)  # -> Rectangle, Length
Z_2 = UnitZ(Factor=multiplication)
Z_3 = UnitZ(Factor=height)
srf = Surface(rec_2pt_3.Rectangle)
srf_2 = Surface(rec_2pt.Rectangle)
Y = UnitY(Factor=width)
pt_5 = ConstructPoint(XCoordinate=neg, YCoordinate=0, ZCoordinate=height)
yz = YZPlane(Origin=pt_2)
explode = Explode(Curve=rec_2pt.Rectangle, Recursive=True)  # -> Segments, Vertices
extr = Extrude(Base=srf, Direction=Z_3)
move = Move(Geometry=[rec_2pt_4.Rectangle, rec_2pt_2.Rectangle], Motion=Y)  # -> Geometry, Transform
extr_2 = Extrude(Base=srf_2, Direction=Z)
rec_2pt_5 = Rectangle2Pt(Plane=yz, PointA=pt_5, PointB=pt_2, Radius=0)  # -> Rectangle, Length
item = ListItem(List=explode.Segments, Index=1, Wrap=True)
extr_3 = Extrude(Base=item, Direction=Z)
area = Area(Geometry=extr_3)  # -> Area, Centroid
move_2 = Move(Geometry=srf_2, Motion=Z)  # -> Geometry, Transform
move_3 = Move(Geometry=srf, Motion=Z)  # -> Geometry, Transform
extr_4 = Extrude(Base=item, Direction=Z_2)
area_2 = Area(Geometry=extr_4)  # -> Area, Centroid
vec2pt = Vector2Pt(PointA=area_2.Centroid, PointB=area.Centroid, Unitize=False)  # -> Vector, Length
floor = ClusterInput()
srf_3 = Surface([move.Geometry, rec_2pt_4.Rectangle, rec_2pt_2.Rectangle, rec_2pt_5.Rectangle])
roof = ClusterInput()
move_4 = Move(Geometry=extr_4, Motion=vec2pt.Vector)  # -> Geometry, Transform
area_3 = Area(Geometry=move_4.Geometry)  # -> Area, Centroid
dispatch = Dispatch(List=[srf, srf_2], DispatchPattern=floor)  # -> ListA, ListB
dispatch_2 = Dispatch(List=[move_3.Geometry, move_2.Geometry], DispatchPattern=roof)  # -> ListA, ListB
scale = Scale(Geometry=move_4.Geometry, Center=area_3.Centroid, Factor=Slider(0.99, range=0..1))  # -> Geometry, Transform
adiabatic = Surface(flatten([srf_3, dispatch_2.ListB, dispatch.ListB]))
expression = Expression(x=orientation, Expression="x - π/2")
ground = Surface(dispatch.ListA)
expression_2 = Expression(x=orientation, Expression="x + π")
data = Data(flatten(scale.Geometry))
rotate = Rotate(Geometry=extr_2, Angle=expression, Plane=PlaneXY(0, 0, 0))  # -> Geometry, Transform
rotate_2 = Rotate(Geometry=ground, Angle=expression, Plane=PlaneXY(0, 0, 0))  # -> Geometry, Transform
rotate_3 = Rotate(Geometry=data, Angle=expression, Plane=PlaneXY(0, 0, 0))  # -> Geometry, Transform
rotate_4 = Rotate(Geometry=extr, Angle=expression, Plane=PlaneXY(0, 0, 0))  # -> Geometry, Transform
rotate_5 = Rotate(Geometry=adiabatic, Angle=expression, Plane=PlaneXY(0, 0, 0))  # -> Geometry, Transform
perimeter = Data(rotate.Geometry)
ground_2 = Data(flatten(rotate_2.Geometry))
core = Data(rotate_4.Geometry)
window = Data(rotate_3.Geometry)
adiabatic_2 = Data(flatten(rotate_5.Geometry))
perimeter_2 = ClusterOutput(perimeter)
core_2 = ClusterOutput(core)
window_2 = ClusterOutput(window)
ground_3 = ClusterOutput(ground_2)
adiabatic_3 = ClusterOutput(adiabatic_2)

# ==== cluster JoulesToKW
pow = Power(A="10", B="-7")
A = ClusterInput()
multiplication = Multiplication(A="2.777", B=pow)
multiplication_2 = Multiplication(A=A, B=multiplication)
R = ClusterOutput(multiplication_2)
